# Grasshopper definition TxtWriter.ghx (Grasshopper 0.9.56)

path = FilePath("C:\Test\test.txt")
path_2 = FilePath(path)
str = String("Hello!")
P = Boolean(True)
boolean = Boolean(Button())
clear = Boolean(Button())
txtwriter = VBScript(filePath=path_2, data=str, append=P, activate=boolean, clearFile=clear)  # -> out, A; inputs data: list
# ---------- txtwriter: VB ----------
    If activate Then

      Dim i As Integer
      Dim aryText(4) As String

      aryText(0) = "Mary WriteLine"
      aryText(1) = "Had"
      aryText(2) = "Another"
      aryText(3) = "Little"
      aryText(4) = "One"

      ' the data is appended to the file. If file doesnt exist, a new file is created
      Dim objWriter As New System.IO.StreamWriter(filePath, append)

      For i = 0 To data.Count - 1
        objWriter.WriteLine(data(i))
      Next

      objWriter.Close()

    End If

    If clearFile Then
      Dim objWriter As New System.IO.StreamWriter(filePath, False)
      objWriter.Close()
    End If
# ---------- end txtwriter ----------
