# Grasshopper definition ej_curso_7_1.gh (Grasshopper 0.9.76)

# ----
# 7.1 - IMAGEN
# Dots
number_slider = Slider(74, range=0..100)
rectangle = Rectangle(Plane=PlaneXY(0, 0, 0), XSize=number_slider, YSize=Slider(55, range=0..100), Radius=0)  # -> Rectangle, Length
boundary = BoundarySurfaces(Edges=rectangle.Rectangle)
number_slider_2 = Slider(77, range=0..100)
sdivide = DivideSurface(Surface=reparameterize(boundary), UCount=number_slider_2, VCount=number_slider_2)  # -> Points, Normals, Parameters
dots = DotDisplay(Point=sdivide.Points, Colour=<missing>, Size=Slider(0.5, range=0..100))

# ----
# Radio en función de
# del color
number_slider_3 = Slider(300, range=0..2000)
number_slider_4 = Slider(369, range=0..1200)
n_1_number_holes_in_x_direction = Slider(243, range=0..900)
n_1_number_of_holes_in_y_direction = Slider(63, range=0..300)
rectangle_2 = Rectangle(Plane=PlaneXY(0, 0, 0), XSize=number_slider_3, YSize=number_slider_4, Radius=0)  # -> Rectangle, Length
int = Integer(5)
int_2 = Integer(5)
dom = Domain(DomainStart=int, DomainEnd=number_slider_3)
dom_2 = Domain(DomainStart=int_2, DomainEnd=number_slider_4)
range = Range(Domain=dom, Steps=n_1_number_holes_in_x_direction)
range_2 = Range(Domain=dom_2, Steps=n_1_number_of_holes_in_y_direction)
crossref = CrossReference(ListA=range, ListB=range_2, CrossMode=1)  # -> ListA, ListB
radius_of_the_largest_circle = Slider(3.582, range=0..5)
circles_radius_tuning = Slider(2.314, range=0..5)
pt = ConstructPoint(XCoordinate=crossref.ListA, YCoordinate=crossref.ListB, ZCoordinate=0)
image = ImageSampler(
    pt,
    FilePath="F:\00. Grasshopper\00. Curso\02. Ejercicios -EPI\escudo_central_negro.jpg",
    Filter="Value",
    Interpolate=False,
    Umax=1417,
    Umin=1,
    Vmax=827,
    Vmin=1,
    Wrap=1)
multiplication = Multiplication(A=<missing>, B=circles_radius_tuning)
min = Minimum(A=multiplication, B=radius_of_the_largest_circle)
panel = Panel(<missing>)
cir = Circle(Plane=pt, Radius=min)
int_3 = Integer(1)
larger = LargerThan(FirstNumber=min, SecondNumber=int_3)  # -> LargerThan, OrEqualTo
cull = CullPattern(List=cir, CullPattern=larger.LargerThan)  # -> flatten(List)
geo = Geometry(cull)
