# Grasshopper definition imagesampler_working.gh (Grasshopper 0.9.72)

# ---- group: Grid Size XY
size_x = Slider(64, range=0..512)
size_y = Slider(64, range=0..512)

# ---- group: UV Tiling (Default 1.0)
u_tiling = Slider(1, range=0..4)
v_tiling = Slider(1, range=0..4)

# ---- group: Grid Divisions XY
divisions_x = Slider(256, range=0..256)
divisions_y = Slider(256, range=0..256)

# ---- group: UV Offset (Default 0.0)
u_offset = Slider(0, range=-1..1)
v_offset = Slider(0, range=-1..1)

# ----
dom = ConstructDomain(DomainStart=0, DomainEnd=size_x)
dom_2 = ConstructDomain(DomainStart=0, DomainEnd=size_y)
range = Range(Domain=dom, Steps=divisions_x)
range_2 = Range(Domain=dom_2, Steps=divisions_y)

pt = ConstructPoint(XCoordinate=graft(range), YCoordinate=range_2, ZCoordinate=0)  # -> flatten(Point)

# ---- group: Remap UV Domain / UV Tiling
dom_3 = ConstructDomain(DomainStart=0, DomainEnd=u_tiling)
dom_4 = ConstructDomain(DomainStart=0, DomainEnd=v_tiling)

# ---- group: Remap UV Domain
bnd = Bounds(Numbers=range)
bnd_2 = Bounds(Numbers=range_2)
remap = RemapNumbers(Value=range, Source=bnd, Target=dom_3)  # -> Mapped, Clipped
remap_2 = RemapNumbers(Value=range_2, Source=bnd_2, Target=dom_4)  # -> Mapped, Clipped

# ---- group: Remap UV Domain / Offset
addition = Addition(A=remap.Mapped, B=u_offset)
addition_2 = Addition(A=remap_2.Mapped, B=v_offset)

# ---- group: Remap UV Domain (continued)
pt_2 = ConstructPoint(XCoordinate=graft(addition), YCoordinate=addition_2, ZCoordinate=0)  # -> flatten(Point)

# ----
image = ImageSampler(
    pt_2,
    FilePath="C:\Users\oleu\Dropbox\Ukko Design\Customers\_Experiments\focusArray\textures\UV_map.jpg",
    Filter="Colour",
    Interpolate=True,
    Umax=1,
    Umin=0,
    Vmax=1,
    Vmin=0,
    Wrap=1)
preview = CustomPreview(Geometry=flatten(pt), Shader=image)
