# Grasshopper definition leds_ventana.gh (Grasshopper 0.9.76)

ancho_ventana = Slider(65, range=0..1000)
alto_ventana = Slider(140, range=0..1000)

num_ventanas = Slider(12, range=1..20)
dist_ventanas = Slider(106, range=0..1000)

num_leds = Slider(60, range=0..100)

rectangle = Rectangle(Plane=PlaneXY(0, 0, 0), XSize=ancho_ventana, YSize=alto_ventana, Radius=0)  # -> Rectangle, Length
series = Series(Start=0, Step=1, Count=num_ventanas)
multiplication = Multiplication(A=series, B=dist_ventanas)
X = UnitX(Factor=multiplication)
move = Move(Geometry=rectangle.Rectangle, Motion=X)  # -> Geometry, Transform
expression = Expression(x=ancho_ventana, y=num_ventanas, z=dist_ventanas, Expression="z*(y-1)+x")
divide = DivideCurve(Curve=move.Geometry, Count=num_leds, Kinks=False)  # -> flatten(Points), Tangents, Parameters
panel = Panel(divide.Points)
pdecon = Deconstruct(Point=divide.Points)  # -> XComponent, YComponent, ZComponent
lng = ListLength(List=divide.Points)
B = Panel("int led_b[n] = {")
B_2 = Panel("int led_g[n] = {")
B_3 = Panel("}")
B_4 = Panel("""pixels.setPixelColor (0, pixels.color (0,0,0));
pixels.show();
for (int i=0; i<n; i++)
{pixels.setPixelColor(i, pixels.color (led_r[i], led_g[i], led_b[i]));
}
delay(1);
pixels.show();""")
B_5 = Panel("int led_r[n] = {")
vb = VBScript(n=lng, y="0", z=",")  # -> out, A
# ---------- vb: VB ----------
    Dim texto As String = Nothing
    For i As Integer = 1 To n - 1
      texto = texto + y + z
    Next
    texto = texto + y
    A = texto
# ---------- end vb ----------
concat = Concatenate(FragmentA=B_5, FragmentB=vb.A, FragmentC=B_3)
concat_2 = Concatenate(FragmentA=B_2, FragmentB=vb.A, FragmentC=B_3)
concat_3 = Concatenate(FragmentA=B, FragmentB=vb.A, FragmentC=B_3)

# ---- group: Remap UV Domain
remap = RemapNumbers(Value=pdecon.XComponent, Source=expression, Target=Domain(0, 1))  # -> Mapped, Clipped
remap_2 = RemapNumbers(Value=pdecon.YComponent, Source=alto_ventana, Target=Domain(0, 1))  # -> Mapped, Clipped

# ---- group: Remap UV Domain / Offset
addition = Addition(A=remap.Mapped)
addition_2 = Addition(A=remap_2.Mapped)

# ---- group: Remap UV Domain (continued)
pt = ConstructPoint(XCoordinate=addition, YCoordinate=addition_2, ZCoordinate=0)  # -> flatten(Point)

# ----
image = ImageSampler(
    pt,
    FilePath="C:\Users\admin\Desktop\Ramon\LEDSVENTANA\Bandera-de-Italia-1024x730.png",
    Filter="Colour",
    Interpolate=False,
    Umax=1,
    Umin=0,
    Vmax=1,
    Vmin=0,
    Wrap=1)
image_2 = ImageSampler(
    pt,
    FilePath="C:\Users\admin\Desktop\Ramon\LEDSVENTANA\spain.jpg",
    Filter="Colour",
    Interpolate=False,
    Umax=1,
    Umin=0,
    Vmax=1,
    Vmin=0,
    Wrap=1)
image_3 = ImageSampler(
    pt,
    FilePath="C:\Users\admin\Desktop\Ramon\LEDSVENTANA\flag-800-38.png",
    Filter="Colour",
    Interpolate=True,
    Umax=1,
    Umin=0,
    Vmax=1,
    Vmin=0,
    Wrap=1)
bandera_txt = Text(image_3)

split = TextSplit(Text=bandera_txt, Separators=",")
item = ListItem(List=split, Index=0, Wrap=True)  # -> flatten(Item)
item_2 = ListItem(List=split, Index=1, Wrap=True)  # -> flatten(Item)
item_3 = ListItem(List=split, Index=2, Wrap=True)  # -> flatten(Item)

preview = CustomPreview(Geometry=divide.Points, Shader=bandera_txt)

series_2 = Series(Start=0, Step=1, Count=10)
int = Integer(series_2)
concat_4 = Concatenate(FragmentA="led_r[", FragmentB=int, FragmentC="]=", FragmentD=item, FragmentE=";")
concat_5 = Concatenate(FragmentA="led_g[", FragmentB=int, FragmentC="]=", FragmentD=item_2, FragmentE=";")
concat_6 = Concatenate(FragmentA="led_b[", FragmentB=int, FragmentC="]=", FragmentD=item_3, FragmentE=";")

txt = Text(flatten([concat_4, concat_5, concat_6]))
B_6 = Panel([concat, concat_2, concat_3, txt, B_4])

panel_2 = Panel(B_6)
path = FilePath("C:\Users\admin\Desktop\Ramon\LEDSVENTANA\leds.txt")
path_2 = FilePath(path)
boolean = Boolean(Button())
str = String(panel_2)
clear = Boolean(Button())
txtwriter = VBScript(filePath=path_2, data=str, append=Toggle(False), activate=boolean, clearFile=clear)  # -> out, A; inputs data: list
# ---------- txtwriter: VB ----------
    If activate Then

      Dim i As Integer
      Dim aryText(4) As String

      aryText(0) = "Mary WriteLine"
      aryText(1) = "Had"
      aryText(2) = "Another"
      aryText(3) = "Little"
      aryText(4) = "One"

      ' the data is appended to the file. If file doesnt exist, a new file is created
      Dim objWriter As New System.IO.StreamWriter(filePath, append)

      For i = 0 To data.Count - 1
        objWriter.WriteLine(data(i))
      Next

      objWriter.Close()

    End If

    If clearFile Then
      Dim objWriter As New System.IO.StreamWriter(filePath, False)
      objWriter.Close()
    End If
# ---------- end txtwriter ----------
