# Grasshopper definition streamcontents.gh (Grasshopper 0.9.14)

panel = Panel("""<!DOCTYPE COPTML>
<project
    compressive_strength="{0}"
    tensile_strength="{1}"
    nodal_spacing="{2}"
    surface_nodes="{3}"
    offset_surface_nodes="{4}"
		joint_cost="{5}">
  <design_space file="domain.obj"/>
  <solids file="shell.obj" t="0.000001" mat="my_mat" is_rigid="1"/>
  <support_surface file="support.obj" free="x"/>
  <load type="force_on_surface" load_case="1" solid_file="loadplate.obj" magnitude="100" min_area_for_nde="0.001"/>
  project>""")
tensile = Slider(10, range=0..10)
compressive = Slider(10, range=0..10)
spacing = Slider(10, range=0..10)
offset_surface_nodes = Slider(10, range=0..10)
surface_nodes = Slider(10, range=0..10)
join_cost = Slider(10, range=0..10)
format = Format(
    Format=panel,
    Data0=compressive,
    Data1=tensile,
    Data2=spacing,
    Data3=surface_nodes,
    Data4=offset_surface_nodes,
    Data5=join_cost)
panel_2 = Panel(format)
