# Grasshopper definition textWritter.gh (Grasshopper 0.8.52)

panel = Panel("""blah
blah""")
text_file_writer = TextFileWriter(filePath="J:\test.txt", data=panel, append=Toggle(False), activate=Toggle(True))  # -> out, A; inputs data: list
# ---------- text_file_writer: VB ----------
    'Code by Victor Leung @ www.dreamationworks.com
    If activate Then

      Dim i As Integer
      Dim aryText(4) As String

      aryText(0) = "Mary WriteLine"
      aryText(1) = "Had"
      aryText(2) = "Another"
      aryText(3) = "Little"
      aryText(4) = "One"

      ' the data is appended to the file. If file doesnt exist, a new file is created
      Dim objWriter As New System.IO.StreamWriter(filePath, append)

      For i = 0 To data.Count - 1
        objWriter.WriteLine(data(i))
      Next

      objWriter.Close()

    End If

    If clearFile Then
      Dim objWriter As New System.IO.StreamWriter(filePath, False)
      objWriter.Close()
    End If
# ---------- end text_file_writer ----------
